# Grasshopper definition BOBINE-2.gh (Grasshopper 1.0.4)
# plug-ins: Spirale

# ---- group: BASE POINT
point = Point(<point referenced from the Rhino model>)

# ---- group: CYLINDER REF
rayons = Slider(6.8, range=1..10)
circle = Circle(Plane=point, Radius=rayons)
cyl_height = Slider(13, range=1..20)
unit_z = UnitZ(Factor=cyl_height)
extrude = Extrude(Base=circle, Direction=unit_z)
cap_holes = CapHoles(Brep=extrude)
custom_preview = CustomPreview(Geometry=cap_holes, Material=ColourSwatch(SwatchColor=RGB(82, 54, 29)))

# ---- group: SPIRALE REF
pitch = Slider(0.6, range=0..5)
unit_z_2 = UnitZ(Factor=1)
nb_tours = Slider(20, range=2..20)
rayons_2 = Slider(7, range=1..10)
spirale = Spirale(
    AxisStart=point,
    AxisDirection=unit_z_2,
    HelixStart=Point(0, 1, 0),
    Pitch=pitch,
    TurnCount=nb_tours,
    R1=rayons_2,
    R2=rayons_2)

# ---- group: SPIRALE RESOLUTION
divide_curve = DivideCurve(Curve=spirale, Count=Slider(92, range=1..100), Kinks=False)  # -> Points, Tangents, Parameters

# ---- group: Z COORDINATE
deconstruct = Deconstruct(Point=divide_curve.Points)  # -> XComponent, YComponent, ZComponent

# ---- group: MOVING RANDOMLY Z
deconstruct_2 = Deconstruct(Point=divide_curve.Points)  # -> XComponent, YComponent, ZComponent
seed = Slider(3, range=1..10)
jitter = Jitter(List=deconstruct_2.ZComponent, Jitter=Slider(0.033, range=0..0.1), Seed=seed)  # -> Values, Indices

# ---- group: VECTEURS
construct_point = ConstructPoint(XCoordinate=0, YCoordinate=0, ZCoordinate=deconstruct.ZComponent)
vector_2pt = Vector2Pt(PointA=construct_point, PointB=divide_curve.Points, Unitize=False)  # -> Vector, Length
vector = Vector(vector_2pt.Vector)
vector_display = VectorDisplay(Anchor=construct_point, Vector=vector)

# ---- group: VECTOR LENGTH REMAP
bounds = Bounds(Numbers=vector_2pt.Length)
seed_2 = Slider(3, range=1..10)
remap_numbers = RemapNumbers(Value=vector_2pt.Length, Source=bounds, Target=Domain(0, 1))  # -> Mapped, Clipped
jitter_2 = Jitter(List=remap_numbers.Mapped, Jitter=Slider(0.3, range=0..1), Seed=seed_2)  # -> Values, Indices
amplitude = Amplitude(Vector=vector, Amplitude=jitter_2.Values)

# ----
construct_point_2 = ConstructPoint(XCoordinate=deconstruct_2.XComponent, YCoordinate=deconstruct_2.YComponent, ZCoordinate=jitter.Values)

# ---- group: MOVING PTS X-Y
move = Move(Geometry=construct_point_2, Motion=amplitude)  # -> Geometry, Transform

# ---- group: NEW CURVE
interpolate = Interpolate(Vertices=move.Geometry, Degree=Slider(3, range=1..3), Periodic=False, KnotStyle=0)  # -> Curve, Length, Domain

# ---- group: EXTENDING THE CURVE
end_points = EndPoints(Curve=interpolate.Curve)  # -> Start, End
curve = Curve(interpolate.Curve)
point_2 = Point(end_points.Start)
point_3 = Point(flatten(point_2))
point_4 = Point(<point referenced from the Rhino model>)
point_5 = Point(<point referenced from the Rhino model>)
point_6 = Point(<point referenced from the Rhino model>)
interpolate_2 = Interpolate(Vertices=[point_3, point_4, point_6, point_5], Degree=3, Periodic=False, KnotStyle=1)  # -> Curve, Length, Domain
join_curves = JoinCurves(Curves=[curve, interpolate_2.Curve], Preserve=False)  # -> flatten(Curves)

# ---- group: PIPING
tube_diameter = Slider(0.3, range=0..2)
pipe = Pipe(Curve=join_curves, Radius=tube_diameter, Caps=0)  # -> flatten(Pipe)
custom_preview_2 = CustomPreview(Geometry=pipe, Material=ColourSwatch(SwatchColor=RGB(255, 132, 18)))
