# Grasshopper definition CIRQUE.gh (Grasshopper 1.0.7)
# Copyright: Liljewall Arkitekter
# plug-ins: Kangaroo Components

construct_point = ConstructPoint(XCoordinate=0, YCoordinate=0, ZCoordinate=0)
polygon = Polygon(Plane=construct_point, Radius=Slider(12, range=0..20), Segments=Slider(12, range=0..20), FilletRadius=0)  # -> Polygon, Length
unit_z = UnitZ(Factor=Slider(12, range=0..20))
move = Move(Geometry=polygon.Polygon, Motion=unit_z)  # -> Geometry, Transform
polygon_center = PolygonCenter(Polyline=move.Geometry)  # -> CenterV, CenterE, CenterA
scale = Scale(Geometry=move.Geometry, Center=polygon_center.CenterV, Factor=Slider(0.5, range=0.1..2))  # -> Geometry, Transform
control_points = ControlPoints(Curve=polygon.Polygon)  # -> Points, Weights, Knots
control_points_2 = ControlPoints(Curve=scale.Geometry)  # -> Points, Weights, Knots
line = Line(StartPoint=control_points.Points, EndPoint=control_points_2.Points)
ruled_surface = RuledSurface(CurveA=polygon.Polygon, CurveB=scale.Geometry)
pipe = Pipe(Curve=[line, polygon.Polygon, scale.Geometry], Radius=Slider(0.05, range=0.01..1), Caps=0)
quaddivide = QuadDivide(Mesh=ruled_surface, Divisions=Slider(5, range=1..10))  # -> flatten(Mesh)
custom_preview = CustomPreview(Geometry=pipe, Material=ColourSwatch(SwatchColor=RGB(161, 161, 161)))
springsfrommesh = SpringsFromMesh(M=quaddivide, stiffness=Slider(913, range=0..1000), B=Slider(0.8, range=0..1))  # -> flatten(S)
gravity = Gravity(M=quaddivide, F=Slider(-9.1, range=-10..10))
kangaroophysics = KangarooPhysics(
    ForceObjects=flatten([gravity, springsfrommesh]),
    AnchorPoints=flatten([control_points_2.Points, control_points.Points]),
    Settings=null,
    Geometry=quaddivide,
    SimulationReset=Toggle(True))  # -> Out, Iterations, ParticlesOut, GeometryOut, KE
custom_preview_2 = CustomPreview(Geometry=kangaroophysics.GeometryOut, Material=ColourSwatch(SwatchColor=RGB(196, 39, 39)))

# ==== cluster SpringsFromMesh: Turns all edges of a mesh into springs
M = ClusterInput()
medges = MeshEdges(Mesh=M)  # -> NakedEdges, InteriorEdges, NonManifoldEdges
crv = Curve([medges.NakedEdges, medges.InteriorEdges])
B = ClusterInput()
len = Length(Curve=crv)
multiplication = Multiplication(A=len, B=B)
stiffness = ClusterInput()
springs = SpringsFromLine(Connection=crv, Stiffness=stiffness, Damping=10, RestLength=multiplication, UpperCutoff=0, LowerCutoff=0, Plasticity=0)
S = ClusterOutput(springs)

# ==== cluster Gravity: Apply gravity to vertices of a mesh
M = ClusterInput()
F = ClusterInput()
mcomp = Decompose(Mesh=M)  # -> Vertices, Faces, Colours, Normals
Z = UnitZ(Factor=F)
duppt = RemoveDuplicatePts(Points=mcomp.Vertices, Tolerance=0.01)
uforce = UnaryForce(Point=duppt, Force=Z)
U = ClusterOutput(uforce)
