# Grasshopper definition Volet-V6.gh (Grasshopper 1.0.7)

# ---- group: FERMETURE
number_slider = Slider(1.8, range=0.1..5)

# ----
construct_point = ConstructPoint(XCoordinate=0, YCoordinate=0, ZCoordinate=Slider(3.5, range=0.1..5))
construct_point_2 = ConstructPoint(XCoordinate=0, YCoordinate=0, ZCoordinate=number_slider)
xz_plane = XZPlane(Origin=construct_point)
xz_plane_2 = XZPlane(Origin=construct_point_2)
circle = Circle(Plane=xz_plane, Radius=Slider(1.1, range=0.1..2))
circle_2 = Circle(Plane=xz_plane_2, Radius=Slider(1.1, range=0.1..2))
point = Point(construct_point)
point_2 = Point(construct_point_2)

# ---- group: POIGNEE
sphere = Sphere(Base=point_2, Radius=Slider(0.1, range=0.1..2))

# ----
curve_curve = CurveCurve(CurveA=circle, CurveB=circle_2)  # -> Points, ParamsA, ParamsB
deconstruct = Deconstruct(Point=curve_curve.Points)  # -> XComponent, YComponent, ZComponent
sort_list = SortList(Keys=deconstruct.ZComponent, ValuesValuesA=curve_curve.Points)  # -> Keys, ValuesValuesA
list_item = ListItem(List=sort_list.ValuesValuesA, Index=0, Wrap=True)  # -> Item, Item1
deconstruct_2 = Deconstruct(Point=list_item.Item1)  # -> XComponent, YComponent, ZComponent
absolute = Absolute(Value=deconstruct_2.XComponent)
construct_point_3 = ConstructPoint(XCoordinate=absolute, YCoordinate=deconstruct_2.YComponent, ZCoordinate=deconstruct_2.ZComponent)
point_3 = Point(construct_point_3)
line = Line(StartPoint=point_3, EndPoint=point_2)
line_2 = Line(StartPoint=point, EndPoint=point_3)
join_curves = JoinCurves(Curves=[line_2, line], Preserve=False)
unit_y = UnitY(Factor=Slider(0.5, range=0.1..2))
move = Move(Geometry=join_curves, Motion=expr("-x", unit_y))  # -> Geometry, Transform
move_2 = Move(Geometry=join_curves, Motion=unit_y)  # -> Geometry, Transform
loft = Loft(
    Curves=[move_2.Geometry, move.Geometry],
    Options={Adjust=False, Closed=False, LoftEnds=0, LoftSimp=0, LoftType=0, Rebuild=10, Refit=0.01})
deconstruct_brep = DeconstructBrep(Brep=loft)  # -> Faces, Edges, Vertices
custom_preview = CustomPreview(Geometry=loft, Material=ColourSwatch(SwatchColor=RGB(255, 255, 255)))
list_item_2 = ListItem(List=deconstruct_brep.Edges, Index=0, Wrap=True)
pipe = Pipe(Curve=list_item_2, Radius=Slider(0.05, range=0.01..1), Caps=2)
