# Grasshopper definition Volet.gh (Grasshopper 1.0.7)
# plug-ins: Bifocals

# ---- group: FERMETURE
number_slider = Slider(1.8, range=0.1..5)

# ----
construct_point = ConstructPoint(XCoordinate=0, YCoordinate=0, ZCoordinate=Slider(3.5, range=0.1..5))
construct_point_2 = ConstructPoint(XCoordinate=0, YCoordinate=0, ZCoordinate=number_slider)
xz_plane = XZPlane(Origin=construct_point)
xz_plane_2 = XZPlane(Origin=construct_point_2)
circle = Circle(Plane=xz_plane, Radius=Slider(1.4, range=0.1..2))
circle_2 = Circle(Plane=xz_plane_2, Radius=Slider(1.4, range=0.1..2))
point = Point(construct_point)
point_2 = Point(construct_point_2)

# ---- group: POIGNEE
sphere = Sphere(Base=point_2, Radius=Slider(0.1, range=0.1..2))

# ----
curve_curve = CurveCurve(CurveA=circle, CurveB=circle_2)  # -> Points, ParamsA, ParamsB
deconstruct = Deconstruct(Point=curve_curve.Points)  # -> XComponent, YComponent, ZComponent
sort_list = SortList(Keys=deconstruct.ZComponent, ValuesValuesA=curve_curve.Points)  # -> Keys, ValuesValuesA
list_item = ListItem(List=sort_list.ValuesValuesA, Index=0, Wrap=True)  # -> Item, Item1
deconstruct_2 = Deconstruct(Point=list_item.Item1)  # -> XComponent, YComponent, ZComponent
absolute = Absolute(Value=deconstruct_2.XComponent)
construct_point_3 = ConstructPoint(XCoordinate=absolute, YCoordinate=deconstruct_2.YComponent, ZCoordinate=deconstruct_2.ZComponent)
point_3 = Point(construct_point_3)
line = Line(StartPoint=point_3, EndPoint=point_2)
line_2 = Line(StartPoint=point, EndPoint=point_3)
join_curves = JoinCurves(Curves=[line_2, line], Preserve=False)
number_slider_2 = Slider(0.8, range=0.1..2)
number_slider_3 = Slider(40, range=2..100)
offset_curve = OffsetCurve(Curve=join_curves, Distance=expr("-x", number_slider_2), Plane=PlaneXY(0, 0, 0), Corners=1)
offset_curve_2 = OffsetCurve(Curve=join_curves, Distance=number_slider_2, Plane=PlaneXY(0, 0, 0), Corners=1)
loft = Loft(
    Curves=[offset_curve, offset_curve_2],
    Options={Adjust=False, Closed=False, LoftEnds=0, LoftSimp=0, LoftType=0, Rebuild=10, Refit=0.01})
divide_curve = DivideCurve(Curve=offset_curve, Count=number_slider_3, Kinks=False)  # -> Points, Tangents, Parameters
divide_curve_2 = DivideCurve(Curve=offset_curve_2, Count=number_slider_3, Kinks=False)  # -> Points, Tangents, Parameters
deconstruct_brep = DeconstructBrep(Brep=loft)  # -> Faces, Edges, Vertices
construct_domain = ConstructDomain(DomainStart=Slider(-0.05, range=-1..1), DomainEnd=Slider(0.05, range=-1..1))
construct_domain_2 = ConstructDomain(DomainStart=0, DomainEnd=1)
xy_plane = XYPlane(Origin=Point(0, 0, 0))
line_3 = Line(StartPoint=divide_curve.Points, EndPoint=divide_curve_2.Points)
rectangle = Rectangle(Plane=xy_plane, XSize=construct_domain, YSize=construct_domain_2, Radius=0)  # -> Rectangle, Length
list_item_2 = ListItem(List=deconstruct_brep.Edges, Index=0, Wrap=True)
# 5
partition_list = PartitionList(List=line_3, Size=5)
loft_2 = Loft(Curves=partition_list, Options={Adjust=False, Closed=False, LoftEnds=0, LoftSimp=0, LoftType=0, Rebuild=10, Refit=0.01})  # -> flatten(Loft)
pipe = Pipe(Curve=list_item_2, Radius=Slider(0.05, range=0.01..1), Caps=2)
brep_join = BrepJoin(Breps=loft_2)  # -> Breps, Closed
evaluate_surface = EvaluateSurface(Surface=brep_join.Breps, Point=divide_curve.Points)  # -> Point, Normal, UDirection, VDirection, Frame
panel = Panel(brep_join.Breps)
amplitude = Amplitude(Vector=evaluate_surface.Normal, Amplitude=Slider(0.05, range=0.01..1))
extrude = Extrude(Base=brep_join.Breps, Direction=expr("-x", amplitude))
custom_preview = CustomPreview(Geometry=extrude, Material=ColourSwatch(SwatchColor=RGB(255, 255, 255)))
