# Grasshopper definition balustrades.gh (Grasshopper 1.0.7)
# Copyright: Liljewall Arkitekter

# ---- group: Straight Line
construct_point = ConstructPoint(XCoordinate=0, YCoordinate=0, ZCoordinate=0)
unit_x = UnitX(Factor=1)
line_sdl = LineSDL(Start=construct_point, Direction=unit_x, Length=Slider(2.4, range=0.1..5))

# ----
curve = Curve(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)

# ---- group: BARRE BASE
number_slider = Slider(-0.05, range=-1..1)
number_slider_2 = Slider(0.05, range=-1..1)
number_slider_3 = Slider(0.01, range=-1..1)
number_slider_4 = Slider(-0.01, range=-1..1)

# ----
number_slider_5 = Slider(26, range=1..50)  # disabled
number_slider_6 = Slider(1, range=0.1..1.5)  # disabled
curve_2 = Curve(<curve referenced from the Rhino model>)  # disabled
divide_curve = DivideCurve(Curve=curve_2, Count=number_slider_5, Kinks=False)  # -> Points, Tangents, Parameters; disabled
unit_z = UnitZ(Factor=number_slider_6)  # disabled
unit_z_2 = UnitZ(Factor=1)  # disabled
list_item = ListItem(List=divide_curve.Points, Index=0, Wrap=True)  # -> Item1, Item; disabled
move = Move(Geometry=curve_2, Motion=unit_z)  # -> Geometry, Transform; disabled
line_sdl_2 = LineSDL(Start=divide_curve.Points, Direction=unit_z_2, Length=number_slider_6)  # disabled
point = Point(list_item.Item1)  # disabled
point_2 = Point(list_item.Item)  # disabled
number_slider_7 = Slider(4.9, range=0.1..5)  # disabled
number_slider_8 = Slider(0.4, range=0.1..5)  # disabled
number_slider_9 = Slider(0.05, range=0.01..5)  # disabled
yz_plane = YZPlane(Origin=Point(0, 0, 0))  # disabled
aligned_dimension = AlignedDimension(Plane=PlaneXY(0, 0, 0), PointA=point, PointB=point_2, Offset=number_slider_7, Text="{0:0.00}", Size=number_slider_8)  # disabled
offset_curve = OffsetCurve(Curve=line_sdl_2, Distance=expr("-x", number_slider_9), Plane=yz_plane, Corners=1)  # disabled
offset_curve_2 = OffsetCurve(Curve=line_sdl_2, Distance=number_slider_9, Plane=yz_plane, Corners=1)  # disabled
loft = Loft(
    Curves=[offset_curve_2, offset_curve],
    Options={Adjust=False, Closed=False, LoftEnds=0, LoftSimp=0, LoftType=0, Rebuild=10, Refit=0.01})  # disabled

absolute = Absolute(Value=number_slider)
absolute_2 = Absolute(Value=number_slider_2)
addition = Addition(A=absolute, B=absolute_2)
addition_2 = Addition(A=addition, B=Slider(0.11, range=0.01..0.5))

# ---- group: Tubes' radius
number_slider_10 = Slider(0.03, range=0.01..0.2)

# ---- group: Distance between tubes
number_slider_11 = Slider(0.11, range=0.1..0.3)

# ----
divide_length = DivideLength(Curve=curve, Length=addition_2)  # -> Points, Tangents, Parameters

multiplication = Multiplication(A=number_slider_10, B="2")
addition_3 = Addition(A=number_slider_11, B=multiplication)

construct_domain = ConstructDomain(DomainStart=number_slider_4, DomainEnd=number_slider_3)
horizontal_frame = HorizontalFrame(Curve=curve, Parameter=divide_length.Parameters)

# ---- group: BARRE BASE
construct_domain_2 = ConstructDomain(DomainStart=number_slider, DomainEnd=number_slider_2)
rectangle = Rectangle(Plane=horizontal_frame, XSize=construct_domain_2, YSize=construct_domain, Radius=0)  # -> Rectangle, Length
boundary_surfaces = BoundarySurfaces(Edges=rectangle.Rectangle)
unit_z_3 = UnitZ(Factor=Slider(1, range=0.1..1.5))
extrude = Extrude(Base=boundary_surfaces, Direction=unit_z_3)

# ----
divide_length_2 = DivideLength(Curve=line_sdl, Length=addition_3)  # -> Points, Tangents, Parameters
unit_z_4 = UnitZ(Factor=1)
line_sdl_3 = LineSDL(Start=divide_length_2.Points, Direction=unit_z_4, Length=Slider(1, range=0.1..5))

# ---- group: COTATION
list_item_2 = ListItem(List=flatten(extrude), Index=0, Wrap=True)  # -> Item, Item1
brep_edges = BrepEdges(Brep=list_item_2.Item)  # -> Naked, Interior, NonManifold
brep_edges_2 = BrepEdges(Brep=list_item_2.Item1)  # -> Naked, Interior, NonManifold
list_item_3 = ListItem(List=brep_edges.Interior, Index=Slider(2, range=0..20), Wrap=True)
list_item_4 = ListItem(List=brep_edges_2.Interior, Index=Slider(14, range=0..20), Wrap=True)
end_points = EndPoints(Curve=list_item_3)  # -> Start, End
end_points_2 = EndPoints(Curve=list_item_4)  # -> Start, End
number_slider_12 = Slider(0.2, range=0.1..5)
number_slider_13 = Slider(0.03, range=0.01..1)
point_3 = Point(end_points.Start)
point_4 = Point(end_points_2.End)
aligned_dimension_2 = AlignedDimension(
    Plane=PlaneXY(0, 0, 0),
    PointA=end_points.Start,
    PointB=end_points.End,
    Offset=number_slider_12,
    Text="{0:0.00}",
    Size=number_slider_13)
aligned_dimension_3 = AlignedDimension(Plane=PlaneXY(0, 0, 0), PointA=point_3, PointB=point_4, Offset=number_slider_12, Text="{0:0.00}", Size=number_slider_13)

# ----
pipe = Pipe(Curve=line_sdl_3, Radius=number_slider_10, Caps=2)

# ---- group: COTATION
box = Box(pipe)
list_item_5 = ListItem(List=flatten(box), Index=0, Wrap=True)  # -> Item, Item1
brep_edges_3 = BrepEdges(Brep=list_item_5.Item)  # -> Naked, Interior, NonManifold
brep_edges_4 = BrepEdges(Brep=list_item_5.Item1)  # -> Naked, Interior, NonManifold
list_item_6 = ListItem(List=brep_edges_3.Interior, Index=Slider(2, range=0..20), Wrap=True)
list_item_7 = ListItem(List=brep_edges_4.Interior, Index=Slider(14, range=0..20), Wrap=True)
end_points_3 = EndPoints(Curve=list_item_6)  # -> Start, End
end_points_4 = EndPoints(Curve=list_item_7)  # -> Start, End
number_slider_14 = Slider(0.2, range=0.1..5)
number_slider_15 = Slider(0.03, range=0.01..1)
point_5 = Point(end_points_3.Start)
point_6 = Point(end_points_4.End)
aligned_dimension_4 = AlignedDimension(
    Plane=PlaneXY(0, 0, 0),
    PointA=end_points_3.Start,
    PointB=end_points_3.End,
    Offset=number_slider_14,
    Text="{0:0.00}",
    Size=number_slider_15)
aligned_dimension_5 = AlignedDimension(Plane=PlaneXY(0, 0, 0), PointA=point_5, PointB=point_6, Offset=number_slider_14, Text="{0:0.00}", Size=number_slider_15)

# ---- group: BARRE BASE
number_slider_16 = Slider(-0.05, range=-1..1)  # disabled
number_slider_17 = Slider(0.05, range=-1..1)  # disabled
number_slider_18 = Slider(0.01, range=-1..1)  # disabled
number_slider_19 = Slider(-0.01, range=-1..1)  # disabled
construct_domain_3 = ConstructDomain(DomainStart=number_slider_16, DomainEnd=number_slider_17)  # disabled
construct_domain_4 = ConstructDomain(DomainStart=number_slider_19, DomainEnd=number_slider_18)  # disabled
xy_plane = XYPlane(Origin=Point(0, 0, 0))  # disabled
number_slider_20 = Slider(1, range=0.1..1.5)  # disabled
rectangle_2 = Rectangle(Plane=xy_plane, XSize=construct_domain_3, YSize=construct_domain_4, Radius=0)  # -> Rectangle, Length; disabled
boundary_surfaces_2 = BoundarySurfaces(Edges=rectangle_2.Rectangle)  # disabled
unit_z_5 = UnitZ(Factor=number_slider_20)  # disabled
extrude_2 = Extrude(Base=boundary_surfaces_2, Direction=unit_z_5)  # disabled

# ----
absolute_3 = Absolute(Value=number_slider_16)  # disabled
absolute_4 = Absolute(Value=number_slider_17)  # disabled
number_slider_21 = Slider(0.1, range=0.01..0.5)  # disabled
addition_4 = Addition(A=absolute_3, B=absolute_4)  # disabled
addition_5 = Addition(A=addition_4, B=number_slider_21)  # disabled

# ---- group: BALLUSTRADE SUR COURBE
curve_3 = Curve(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)  # disabled
length = Length(Curve=curve_3)  # disabled
division = Division(A=length, B=addition_5)  # disabled
round = Round(Number=division)  # -> Nearest, Floor, Ceiling; disabled
horizontal_frames = HorizontalFrames(Curve=curve_3, Count=round.Nearest)  # -> Frames, Parameters; disabled
orient = Orient(Geometry=extrude_2, Source=PlaneXY(0, 0, 0), Target=horizontal_frames.Frames)  # -> Geometry, Transform; disabled

# ---- group: BALLUSTRADE SUR DROITE
construct_point_2 = ConstructPoint(XCoordinate=0, YCoordinate=0, ZCoordinate=0)  # disabled
number_slider_22 = Slider(9.2, range=0.5..20)  # disabled
unit_x_2 = UnitX(Factor=1)  # disabled
line_sdl_4 = LineSDL(Start=construct_point_2, Direction=unit_x_2, Length=number_slider_22)  # disabled
length_2 = Length(Curve=line_sdl_4)  # disabled
division_2 = Division(A=length_2, B=addition_5)  # disabled
round_2 = Round(Number=division_2)  # -> Nearest, Floor, Ceiling; disabled
divide_curve_2 = DivideCurve(Curve=line_sdl_4, Count=round_2.Floor, Kinks=False)  # -> Points, Tangents, Parameters; disabled
orient_2 = Orient(Geometry=extrude_2, Source=PlaneXY(0, 0, 0), Target=divide_curve_2.Points)  # -> Geometry, Transform; disabled

# ---- group: COTATION
list_item_8 = ListItem(List=orient.Geometry, Index=0, Wrap=True)  # -> Item, Item1; disabled
brep_edges_5 = BrepEdges(Brep=list_item_8.Item)  # -> Naked, Interior, NonManifold; disabled
brep_edges_6 = BrepEdges(Brep=list_item_8.Item1)  # -> Naked, Interior, NonManifold; disabled
number_slider_23 = Slider(6, range=0..20)  # disabled
number_slider_24 = Slider(4, range=0..20)  # disabled
list_item_9 = ListItem(List=brep_edges_5.Interior, Index=number_slider_23, Wrap=True)  # disabled
list_item_10 = ListItem(List=brep_edges_6.Interior, Index=number_slider_24, Wrap=True)  # disabled
end_points_5 = EndPoints(Curve=list_item_9)  # -> Start, End; disabled
end_points_6 = EndPoints(Curve=list_item_10)  # -> Start, End; disabled
number_slider_25 = Slider(0.7, range=0.1..5)  # disabled
number_slider_26 = Slider(0.1, range=0.1..5)  # disabled
point_7 = Point(end_points_5.End)  # disabled
point_8 = Point(end_points_6.Start)  # disabled
aligned_dimension_6 = AlignedDimension(Plane=PlaneXY(0, 0, 0), PointA=point_7, PointB=point_8, Offset=number_slider_25, Text="{0:0.00}", Size=number_slider_26)  # disabled
