# Grasshopper definition kangoroo.gh (Grasshopper 1.0.7)
# plug-ins: Kangaroo Components, Kangaroo2 Components

circle = Circle()
number_slider = Slider(8, range=1..40)
number_slider_2 = Slider(32, range=1..40)
surface = Surface(<surface referenced from the Rhino model>)
point = Point([<point referenced from the Rhino model> x4])
mesh_surface = MeshSurface(Surface=surface, UCount=number_slider_2, VCount=number_slider_2, Overhang=True, Equalize=False)
surface_2 = Surface(<surface referenced from the Rhino model>)
diagonalize = Diagonalize(Mesh=mesh_surface)
mesh_surface_2 = MeshSurface(Surface=surface_2, UCount=number_slider, VCount=number_slider, Overhang=True, Equalize=Toggle(False))
gravity = Gravity(M=diagonalize, F=Slider(5, range=-100..100))
springsfrommesh = SpringsFromMesh(M=mesh_surface_2, stiffness=1000, B=Slider(0.77, range=0..1))
springsfrommesh_2 = SpringsFromMesh(M=diagonalize, stiffness=1000, B=Slider(0.92, range=0..1))
point_2 = Point()
deconstruct_mesh = DeconstructMesh(Mesh=mesh_surface_2)  # -> Vertices, Faces, Colours, Normals
nakedvertices = NakedVertices(Mesh=mesh_surface_2)  # -> ClothedIndex, NakedIndex, ClothedPts, NakedPts
zombiekangaroo = ZombieKangaroo(
    ForceObjects=flatten([gravity, springsfrommesh_2]),
    AnchorPoints=point,
    Settings=null,
    Geometry=diagonalize,
    Threshold=0.1,
    MaxIters=2000)  # -> Out, Iterations, ParticlesOut, GeometryOut, KE
kangaroophysics = KangarooPhysics(
    ForceObjects=flatten([springsfrommesh_2, gravity]),
    AnchorPoints=[Point(-20, -20, 0), Point(-20, 20, 0), Point(20, 20, 0), Point(20, -20, 0)],
    Geometry=mesh_surface,
    SimulationReset=True)  # -> Out, Iterations, ParticlesOut, GeometryOut, KE
point_3 = Point(nakedvertices.NakedPts)
construct_domain = ConstructDomain(DomainStart=Slider(0, range=0..10), DomainEnd=Slider(8, range=0..100))
mesh = Mesh(zombiekangaroo.GeometryOut)
construct_domain_2 = ConstructDomain(DomainStart=0, DomainEnd=1)
sub_list = SubList(List=point_3, Domain=construct_domain, Wrap=True)  # -> List, Index
list_item = ListItem(List=point_3, Index=Slider(21, range=0..32), Wrap=True)
construct_domain_3 = ConstructDomain(DomainStart=Slider(23, range=0..100), DomainEnd=Slider(30, range=0..100))
bouncysolver = BouncySolver(Reset=False, Threshold=1e-15, Tolerance=0.01, Damping=0.99, Iterations=10, On=True)  # -> I, V, O
custom_preview = CustomPreview(
    Geometry=mesh,
    Material={diffuse=RGB(221, 160, 221), emission=RGB(66, 48, 66), shine=0.5, specular=RGB(255, 255, 255), transparency=0})
list_length = ListLength(List=sub_list.List)
sub_list_2 = SubList(List=point_3, Domain=construct_domain_3, Wrap=True)  # -> List, Index
point_4 = Point([sub_list.List, sub_list_2.List])
kangaroophysics_2 = KangarooPhysics(ForceObjects=springsfrommesh, AnchorPoints=point_4, Settings=null, Geometry=mesh_surface_2, SimulationReset=True)  # -> Out, Iterations, ParticlesOut, GeometryOut, KE
mesh_2 = Mesh(kangaroophysics_2.GeometryOut)

# ==== cluster SpringsFromMesh: Turns all edges of a mesh into springs
M = ClusterInput()
medges = MeshEdges(Mesh=M)  # -> NakedEdges, InteriorEdges, NonManifoldEdges
crv = Curve([medges.NakedEdges, medges.InteriorEdges])
B = ClusterInput()
len = Length(Curve=crv)
multiplication = Multiplication(A=len, B=B)
stiffness = ClusterInput()
springs = SpringsFromLine(Connection=crv, Stiffness=stiffness, Damping=10, RestLength=multiplication, UpperCutoff=0, LowerCutoff=0, Plasticity=0)
S = ClusterOutput(springs)

# ==== cluster Gravity: Apply gravity to vertices of a mesh
M = ClusterInput()
F = ClusterInput()
mcomp = Decompose(Mesh=M)  # -> Vertices, Faces, Colours, Normals
Z = UnitZ(Factor=F)
duppt = RemoveDuplicatePts(Points=mcomp.Vertices, Tolerance=0.01)
uforce = UnaryForce(Point=duppt, Force=Z)
U = ClusterOutput(uforce)
