# Grasshopper definition rectangle.gh (Grasshopper 1.0.7)
# Copyright: Liljewall Arkitekter

construct_domain = ConstructDomain(DomainStart=Slider(-0.05, range=-1..1), DomainEnd=Slider(0.05, range=-1..1))
construct_domain_2 = ConstructDomain(DomainStart=0, DomainEnd=1)
xy_plane = XYPlane(Origin=Point(0, 0, 0))
rectangle = Rectangle(Plane=xy_plane, XSize=construct_domain, YSize=construct_domain_2, Radius=0)  # -> Rectangle, Length
