# Grasshopper definition voronoi.gh (Grasshopper 1.0.7)

surface = Surface(<surface referenced from the Rhino model>)
dimensions = Dimensions(Surface=surface)  # -> UDimension, VDimension
plane_surface = PlaneSurface(Plane=PlaneXY(0, 0, 0), XSize=dimensions.UDimension, YSize=dimensions.VDimension)
populate_2d = Populate2D(Region=plane_surface, Count=Slider(71, range=50..200), Seed=Slider(41, range=0..100))
voronoi_3d = Voronoi3D(Points=populate_2d)  # -> Cells, Boundary
area = Area(Geometry=voronoi_3d.Cells)  # -> Area, Centroid
scale = Scale(Geometry=voronoi_3d.Cells, Center=area.Centroid, Factor=Slider(0.8, range=0..1))  # -> Geometry, Transform
surface_2 = Surface(plane_surface)
deconstruct_brep = DeconstructBrep(Brep=scale.Geometry)  # -> Faces, Edges, Vertices
curve = Curve(flatten(plane_surface))
surface_3 = Surface(surface)
number_slider = Slider(2, range=0..5)
curve_2 = Curve(flatten([plane_surface, deconstruct_brep.Edges]))
unit_z = UnitZ(Factor=number_slider)
unit_z_2 = UnitZ(Factor=number_slider)
curve_3 = Curve()
boundary_surfaces = BoundarySurfaces(Edges=curve_3)
extrude = Extrude(Base=surface_2, Direction=unit_z)
number_slider_2 = Slider(1, range=0..1)
extrude_2 = Extrude(Base=boundary_surfaces, Direction=unit_z_2)
surface_morph = SurfaceMorph(
    Geometry=extrude_2,
    Reference=extrude,
    Surface=reparameterize(surface_3),
    UDomain=number_slider_2,
    VDomain=number_slider_2,
    WDomain=number_slider_2)
surface_4 = Surface()
box = Box()
custom_preview = CustomPreview(
    Geometry=surface_morph,
    Material={diffuse=RGB(221, 160, 221), emission=RGB(66, 48, 66), shine=0.5, specular=RGB(255, 255, 255), transparency=0})
